# Grasshopper definition fakedata.gh (Grasshopper 1.0.7)
# plug-ins: Virtual Robot

predefined_kuka_kr_125_2 = PredefinedKUKAKR1252(RobRootFrame=PlaneXY(0, 0, 0))
merge = Merge(
    Data1=Slider(-28, range=-180..180),
    Data2=Slider(-51, range=-180..180),
    Data3=Slider(74, range=-180..180),
    Data4=Slider(148, range=-180..180),
    Data5=Slider(-35, range=-180..180),
    Data6=Slider(-56, range=-180..180))

# ----
# world to object
plane = Plane(PlaneXY(1810, 1530, 0))
plane2matrix = Plane2matrix(target=plane)

# ----
# world to end
robot_forward_kinematics = RobotForwardKinematics(Robot=predefined_kuka_kr_125_2, AxisValues=merge, useColorPreview=True)  # -> PoseGeometry, TCPFrame
plane2matrix_2 = Plane2matrix(target=robot_forward_kinematics.TCPFrame)

# ----
# end to camera
plane_2 = Plane(Plane(origin=(0, 2.819077862, 24.97393957), x=(0.9559237072, 0.1644949642, -0.2432103468), y=(-0.2432103468, 0.9076733712, -0.3420201433)))
plane2matrix_3 = Plane2matrix(target=plane_2)

deconstruct_matrix = DeconstructMatrix(Matrix=plane2matrix_3)  # -> Rows, Columns, Values
text = Text(flatten(deconstruct_matrix.Values))
text_join = TextJoin(Text=["e2c:", text], Join=" ")
panel = Panel(text_join)

deconstruct_matrix_2 = DeconstructMatrix(Matrix=plane2matrix_2)  # -> Rows, Columns, Values
text_2 = Text(flatten(deconstruct_matrix_2.Values))
text_join_2 = TextJoin(Text=["w2e:", text_2], Join=" ")
panel_2 = Panel(text_join_2)

# ----
# world to camera
multiplication = Multiplication(A=plane2matrix_2, B=plane2matrix_3)
invert_matrix = InvertMatrix(Matrix=multiplication, Tolerance=0)  # -> Matrix, Success
pose2plane = Pose2plane(matrix=multiplication)
# camera to object
multiplication_2 = Multiplication(A=invert_matrix.Matrix, B=plane2matrix)

deconstruct_matrix_3 = DeconstructMatrix(Matrix=multiplication_2)  # -> Rows, Columns, Values
text_3 = Text(flatten(deconstruct_matrix_3.Values))
text_join_3 = TextJoin(Text=["c20:", text_3], Join=" ")
panel_3 = Panel(text_join_3)

pose2plane_2 = Pose2plane(matrix=multiplication_2)

# ==== cluster Pose2plane
matrix = ClusterInput()
deconstruct_matrix = DeconstructMatrix(Matrix=matrix)  # -> Rows, Columns, Values
panel = Panel("""3
7
11""")
panel_2 = Panel("""0
4
8""")
panel_3 = Panel("""1
5
9""")
list_item = ListItem(List=deconstruct_matrix.Values, Index=panel, Wrap=True)
list_item_2 = ListItem(List=deconstruct_matrix.Values, Index=panel_2, Wrap=True)
list_item_3 = ListItem(List=deconstruct_matrix.Values, Index=panel_3, Wrap=True)
list_item_4 = ListItem(List=list_item, Index=0, Wrap=True)  # -> Item, Item1, Item2
list_item_5 = ListItem(List=list_item_2, Index=0, Wrap=True)  # -> Item, Item1, Item2
list_item_6 = ListItem(List=list_item_3, Index=0, Wrap=True)  # -> Item, Item1, Item2
construct_point = ConstructPoint(XCoordinate=list_item_4.Item, YCoordinate=list_item_4.Item1, ZCoordinate=list_item_4.Item2)
vector_xyz = VectorXYZ(XComponent=list_item_5.Item, YComponent=list_item_5.Item1, ZComponent=list_item_5.Item2)  # -> Vector, Length
vector_xyz_2 = VectorXYZ(XComponent=list_item_6.Item, YComponent=list_item_6.Item1, ZComponent=list_item_6.Item2)  # -> Vector, Length
construct_plane = ConstructPlane(Origin=construct_point, XAxis=vector_xyz.Vector, YAxis=vector_xyz_2.Vector)
plane = ClusterOutput(construct_plane)

# ==== cluster Plane2matrix
xy_plane = XYPlane(Origin=Point(0, 0, 0))
target = ClusterInput()
orient = Orient(Source=xy_plane, Target=target)  # -> Geometry, Transform
matrix = Matrix(orient.Transform)
matrix_2 = ClusterOutput(matrix)
