# Grasshopper definition result_visualization.gh (Grasshopper 1.0.7)

read_file = ReadFile(File="C:\Users\77777777\source\repos\machine_perception\demo4.1_tracking\opt\data\l.txt", PerLineParse=True)
read_file_2 = ReadFile(File="C:\Users\77777777\source\repos\machine_perception\demo4.1_tracking\opt\data\m.txt", PerLineParse=True)
read_file_3 = ReadFile(File="C:\Users\77777777\source\repos\machine_perception\demo4.1_tracking\opt\data\t.txt", PerLineParse=True)
read_file_4 = ReadFile(File="C:\Users\77777777\source\repos\machine_perception\demo4.1_tracking\opt\result.txt", PerLineParse=True)
cluster = Cluster(str=read_file_4)
cylinder_reader = GhPythonScript(str=read_file_3)  # -> out, p
# ---------- cylinder_reader: Python ----------
import Rhino.Geometry as rg


nums = str.split(" ")

p = rg.Point3d(float(nums[0]), float(nums[1]), float(nums[2]))
# ---------- end cylinder_reader ----------
panel = Panel(read_file)
visualize_cylinder = Visualize_cylinder(text=read_file)  # -> line, r
visualize_cylinder_2 = Visualize_cylinder(text=read_file_2)  # -> line, r
point = Point(cylinder_reader.p)
transform = Transform(cluster)
pipe = Pipe(Curve=visualize_cylinder_2.line, Radius=visualize_cylinder_2.r, Caps=0)
transform_2 = Transform(Geometry=visualize_cylinder.line, Transform=transform)
pipe_2 = Pipe(Curve=transform_2, Radius=visualize_cylinder.r, Caps=0)
list_item = ListItem(List=transform_2, Index=0, Wrap=True)
cluster_2 = Cluster_3(curve_2=list_item, curve=visualize_cylinder_2.line)  # -> point_2, point
list_item_2 = ListItem(List=visualize_cylinder.r, Index=0, Wrap=True)
distance = Distance(PointA=cluster_2.point_2, PointB=cluster_2.point)
addition = Addition(A=list_item_2, B=visualize_cylinder_2.r)
subtraction = Subtraction(A=distance, B=addition)
panel_2 = Panel(subtraction)

# ==== cluster Visualize_cylinder
text = ClusterInput()
text_2 = Text(text)
cylinder_reader = GhPythonScript(str=text_2)  # -> out, r, p, v
# ---------- cylinder_reader: Python ----------
import Rhino.Geometry as rg


nums = str.split(" ")

p = rg.Point3d(float(nums[0]), float(nums[1]), float(nums[2]))
v = rg.Vector3d(float(nums[3]), float(nums[4]), float(nums[5]))
r = float(nums[6])
# ---------- end cylinder_reader ----------
unit_vector = UnitVector(Vector=cylinder_reader.v)
line_sdl = LineSDL(Start=cylinder_reader.p, Direction=unit_vector, Length="25")
line = ClusterOutput(line_sdl)
r = ClusterOutput(cylinder_reader.r)

# ==== cluster Cluster
str = ClusterInput()
cylinder_reader = GhPythonScript(str=str)  # -> out, v, t
# ---------- cylinder_reader: Python ----------
import Rhino.Geometry as rg


nums = str.split(" ")

v = rg.Vector3d(float(nums[0]), float(nums[1]), float(nums[2]))
t = rg.Vector3d(float(nums[3]), float(nums[4]), float(nums[5]))
# ---------- end cylinder_reader ----------
vector_length = VectorLength(Vector=cylinder_reader.v)
move = Move(Motion=cylinder_reader.t)  # -> Geometry, Transform
rotate_3d = Rotate3D(Angle=vector_length, Center=Point(0, 0, 0), Axis=cylinder_reader.v)  # -> Geometry, Transform
compound = Compound(Transforms=[rotate_3d.Transform, move.Transform])
compound_2 = ClusterOutput(compound)

# ==== cluster Cluster_3
curve = ClusterInput()
curve_2 = ClusterInput()
curve_3 = Curve(curve)
curve_4 = Curve(curve_2)
cluster = Cluster_2(curve=curve_3, curve_2=curve_4)
cluster_2 = Cluster_2(curve=curve_4, curve_2=curve_3)
point = ClusterOutput(cluster)
point_2 = ClusterOutput(cluster_2)

# ==== cluster Cluster_2
curve = ClusterInput()
curve_2 = ClusterInput()
curve_3 = Curve(curve)
curve_4 = Curve(curve_2)
cross_product = CrossProduct(VectorA=curve_3, VectorB=curve_4, Unitize=False)  # -> Vector, Length
end_points = EndPoints(Curve=curve_3)  # -> Start, End
line_sdl = LineSDL(Start=end_points.Start, Direction=cross_product.Vector, Length=1)
line_line = LineLine(LineA=curve_3, LineB=line_sdl)
line_plane = LinePlane(Line=curve_4, Plane=line_line)  # -> Point, ParamL, ParamP
point = ClusterOutput(line_plane.Point)
