# Grasshopper definition get_cylinder_param.gh (Grasshopper 1.0.7)

# ---- group: get_cylinder_params
curve = Curve([<curve referenced from the Rhino model> x2])
vector = Vector(expr("-x", Vector(15, 15.00000473, 5)))
move = Move(Geometry=curve, Motion=vector)  # -> Geometry, Transform
end_points = EndPoints(Curve=move.Geometry)  # -> Start, End
vector_2pt = Vector2Pt(PointA=end_points.Start, PointB=end_points.End, Unitize=True)  # -> Vector, Length
R = Panel("10.0")
panel = Panel(end_points.Start)
panel_2 = Panel(vector_2pt.Vector)
ghpython_script = GhPythonScript(p=end_points.Start, v=vector_2pt.Vector, r=R)  # -> out; inputs p: list of Point3d, v: list of Vector3d
# ---------- ghpython_script: Python ----------
for i in range(len(p)):
    print str(r)+" "+str(p[i].X)+" "+str(p[i].Y)+" "+str(p[i].Z)+" "+str(v[i].X)+" "+str(v[i].Y)+" "+str(v[i].Z)
# ---------- end ghpython_script ----------
panel_3 = Panel(ghpython_script)
