# Grasshopper definition connector.gh (Grasshopper 1.0.7)

x_size = Panel("20")
radius_cylinder = Panel("10.0")
y_size = Panel("20.0")
x_dis_hole = Panel("0")
point = Point(<point referenced from the Rhino model>)
line = Line(Line((-7215.337989, 5.775159838, 375.5271056), (-7202.76061, 14.22484016, 362.4728944)))
cluster = Cluster(point=point, number_3=x_size, number_2=x_dis_hole, number=y_size, curve=line, number_4=radius_cylinder)
brep = Brep(cluster)

# ==== cluster Cluster
number = ClusterInput()
number_2 = ClusterInput()
curve = ClusterInput()
number_3 = ClusterInput()
point = ClusterInput()
number_4 = ClusterInput()
number_5 = Number(number)
number_6 = Number(number_2)
curve_2 = Curve(curve)
number_7 = Number(number_3)
point_2 = Point(point)
number_8 = Number(number_4)

unit_x = UnitX(Factor=number_6)
move = Move(Geometry=point_2, Motion=expr("-x", unit_x))  # -> Geometry, Transform
move_2 = Move(Geometry=point_2, Motion=unit_x)  # -> Geometry, Transform
cylinder = Cylinder(Base=[move.Geometry, move_2.Geometry], Radius="1.65", Length="-12")
cap_holes = CapHoles(Brep=cylinder)

extend_curve = ExtendCurve(Curve=curve_2, Type=0, Start=100, End=100)
pipe = Pipe(Curve=extend_curve, Radius=number_8, Caps=1)

unit_z = UnitZ(Factor=1)
construct_domain = ConstructDomain(DomainStart=expr("-0.5*x", number_7), DomainEnd=expr("0.5*x", number_7))
construct_domain_2 = ConstructDomain(DomainStart=expr("-0.5*x", number_5), DomainEnd=expr("0.5*x", number_5))
vector = Vector(curve_2)
cross_product = CrossProduct(VectorA=unit_z, VectorB=vector, Unitize=True)  # -> Vector, Length
number_9 = Number("54.0")
construct_domain_3 = ConstructDomain(DomainStart=expr("-0.5*x", number_9), DomainEnd=expr("0.5*x", number_9))
subtraction = Subtraction(A=number_8, B="5")
rectangle = Rectangle(Plane=point_2, XSize=construct_domain, YSize=construct_domain_2, Radius=0)  # -> Rectangle, Length

end_points = EndPoints(Curve=curve_2)  # -> Start, End
construct_plane = ConstructPlane(Origin=end_points.End, XAxis=vector, YAxis=cross_product.Vector)
construct_plane_2 = ConstructPlane(Origin=end_points.Start, XAxis=vector, YAxis=cross_product.Vector)
cylinder_2 = Cylinder(Base=[construct_plane_2, construct_plane], Radius="1.65", Length="22")
cap_holes_2 = CapHoles(Brep=cylinder_2)

midpoint = MidPoint(A=end_points.Start, B=end_points.End)
point_3 = Point(midpoint)
construct_plane_3 = ConstructPlane(Origin=point_3, XAxis=vector, YAxis=cross_product.Vector)
plane_offset = PlaneOffset(BasePlane=construct_plane_3, Offset=subtraction)
rectangle_2 = Rectangle(Plane=plane_offset, XSize=construct_domain_3, YSize=construct_domain_2, Radius=0)  # -> Rectangle, Length
loft = Loft(
    Curves=[rectangle.Rectangle, rectangle_2.Rectangle],
    Options={Adjust=False, Closed=False, LoftEnds=0, LoftSimp=0, LoftType=0, Rebuild=10, Refit=0.01})
cap_holes_3 = CapHoles(Brep=loft)

solid_difference = SolidDifference(BrepsA=cap_holes_3, BrepsB=flatten([cap_holes, cap_holes_2, pipe]))
result = ClusterOutput(solid_difference)

# ==== cluster MidPoint
A = ClusterInput()
B = ClusterInput()
addition = Addition(A=A, B=B)
point = Point(expr("0.5*x", addition))
point_2 = ClusterOutput(point)
