# Grasshopper definition KukaVarProxy.gh (Grasshopper 1.0.7)
# plug-ins: Simulacrum, Virtual Robot

timer = Timer(TimerInterval=1000, Target=ghpython_script)
ghpython_script = GhPythonScript(reset=Toggle(False))  # -> out, pc; inputs reset: Boolean
# ---------- ghpython_script: Python ----------
import Rhino.Geometry as rg
import Grasshopper as gh

if reset:
    line_count = 0
    f = open('poses.txt','r')
    try:
        lines = f.readlines()
    finally:
        f.close()

if line_count < len(lines):
    nums = lines[line_count].split(" ")
    for num in nums:
        print float(num.replace("\n", ""))
line_count += 1

#    for line in lines:
#        print line
#        if count % 180 == 0:
#            pth = gh.Kernel.Data.GH_Path(count/180)
#        
#        if line[0] != "v" or line[1] == "n":
#            continue
#        nums = line.split(" ")
#        x = float(nums[1].replace(",", "."))
#        y = float(nums[2].replace(",", "."))
#        z = float(nums[3].replace(",", "."))
#        
#        pc.Add(1000 * rg.Point3d(x, y, z), pth)
#        count += 1
# ---------- end ghpython_script ----------
panel = Panel(ghpython_script.out)
client = TCPClient(ServerIP="141.58.154.149", ServerPort="7000", ConnectionTrigger=Toggle(False))

# ---- group: Write Values
panel_2 = Panel(panel)
write_position = WritePosition(Socket=client, Write="MyPosSimon", AxisValues=panel_2, Run=Button(), RefreshRate=20)
custom_write = KRCWrite(Socket=client, Write="SimonBool", Input="False", Run=Button(), RefreshRate=20)
panel_3 = Panel(custom_write)
panel_4 = Panel(write_position)

# ---- group: Read Values
read_position = ReadActPos(Socket=client, Run=Toggle(False), RefreshRate="300")  # -> AxisValues, TCPPlane, XYZ, ABC, E6POS, E6AXIS
custom_read = KRCRead(Socket=client, VarRead="SimonBool", ReadTrigger=Toggle(True), RefreshRate=20)
read_base = ReadBase(Socket=client, Run=Button())  # -> BASE, BASEPlane, TOOL, TOOLPlane
panel_5 = Panel(custom_read)
panel_6 = Panel(read_position.AxisValues)
pln = Plane(read_base.TOOLPlane)
pln_2 = Plane(read_base.BASEPlane)
panel_7 = Panel(read_base.TOOL)
panel_8 = Panel(read_base.BASE)
pln_3 = Plane(read_position.TCPPlane)

# ----
monitor = NetstatMonitor(Socket=client)  # disabled

# ---- group: Check Connection
panel_9 = Panel(monitor)

# ---- group: Kuka Datatype Converter
converter = Converter(E6POS=read_position.E6POS, E6AXIS=read_position.E6AXIS)  # -> E6POSNames, E6POSValues, E6AXISNames, E6AXISValues, FRAMENames, FRAMEValues
panel_10 = Panel(converter.E6POSNames)
panel_11 = Panel(converter.E6POSValues)

# ----
kuka_kr_125_2 = PredefinedKUKAKR1252(RobRootFrame=PlaneXY(0, 0, 0))

# ---- group: Robot Sim
robot_fk = RobotForwardKinematics(Robot=kuka_kr_125_2, AxisValues=panel_6, useColorPreview=True)  # -> PoseGeometry, TCPFrame
pln_4 = Plane(robot_fk.TCPFrame)
