# Grasshopper definition milling_tool_path.gh (Grasshopper 1.0.7)
# plug-ins: Sandbox, Virtual Robot

diameter_tool = Panel("10")
cutter_go_outwards_dis = Panel("50")
cutter_length_tool = Panel("15")
diameter2 = Panel("50")
# bamboo2 (existing one)
curve = Curve(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)
diameter1 = Panel("50")
# bamboo1(to be cut)
curve_2 = Curve(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)
cluster = Cluster(curve=curve_2, curve_2=curve)
cluster_2 = Cluster(curve=curve, curve_2=curve_2)
point = Point(cluster_2)
point_2 = Point(cluster)
cluster_3 = Cluster_2(point=point_2, vector_a=curve_2, curve=curve, A=diameter1, B=diameter2)  # -> geometry, geometry_2
line = Line(StartPoint=point_2, EndPoint=point)
cross_product = CrossProduct(VectorA=line, VectorB=curve, Unitize=False)  # -> Vector, Length

# ---- group: arcs
# might be flipped, need to be checked
point_3 = Point(cluster_3.geometry_2)
point_4 = Point(cluster_3.geometry)
line_2 = Line(StartPoint=point_4, EndPoint=point_3)
length = Length(Curve=line_2)
division = Division(A=length, B=cutter_length_tool)
integer = Integer(division)
divide_curve = DivideCurve(Curve=line_2, Count=integer, Kinks=False)  # -> Points, Tangents, Parameters
construct_plane = ConstructPlane(Origin=divide_curve.Points, XAxis=line, YAxis=cross_product.Vector)
subtraction = Subtraction(A=diameter1, B=diameter_tool)
arc = Arc(Plane=construct_plane, Radius=expr("x * 0.5", subtraction), Angle=Domain(-1.570796327, 1.570796327))  # -> Arc, Length
custom_preview = CustomPreview(
    Geometry=arc.Arc,
    Material={diffuse=RGB(221, 160, 221), emission=RGB(66, 48, 66), shine=0.5, specular=RGB(255, 255, 255), transparency=0})

# ---- group: tool path
curve_3 = Curve(arc.Arc)
end_points = EndPoints(Curve=curve_3)  # -> Start, End
line_sdl = LineSDL(Start=end_points.Start, Direction=expr("-x", line), Length=cutter_go_outwards_dis)
line_sdl_2 = LineSDL(Start=end_points.End, Direction=expr("-x", line), Length=cutter_go_outwards_dis)
end_points_2 = EndPoints(Curve=line_sdl)  # -> Start, End
end_points_3 = EndPoints(Curve=line_sdl_2)  # -> Start, End
shift_list = ShiftList(List=end_points_2.End, Shift=-1, Wrap=False)
shift_list_2 = ShiftList(List=end_points_2.End, Shift=1, Wrap=False)
shift_list_3 = ShiftList(List=end_points_3.End, Shift=-1, Wrap=False)
shift_list_4 = ShiftList(List=end_points_3.End, Shift=1, Wrap=False)
list_length = ListLength(List=shift_list)
series = Series(Start=0, Step=1, Count=list_length)
modulus = Modulus(A=series, B="2")
equality = Equality(FirstNumber=modulus, SecondNumber="0")  # -> Equality, Inequality
cull_pattern = CullPattern(List=shift_list, CullPattern=equality.Equality)
cull_pattern_2 = CullPattern(List=shift_list_2, CullPattern=equality.Equality)
cull_pattern_3 = CullPattern(List=shift_list_3, CullPattern=equality.Inequality)
cull_pattern_4 = CullPattern(List=shift_list_4, CullPattern=equality.Inequality)
line_3 = Line(StartPoint=cull_pattern, EndPoint=cull_pattern_2)
rebuild_curve = RebuildCurve(Curve=arc.Arc, Degree=1, Count=20, Tangents=False)
line_4 = Line(StartPoint=cull_pattern_3, EndPoint=cull_pattern_4)

# ----
join_curves = JoinCurves(Curves=flatten([line_sdl, line_sdl_2, line_3, line_4, rebuild_curve]), Preserve=False)

# ---- group: robot sim
curve_4 = Curve(join_curves)
explode = Explode(Curve=curve_4, Recursive=True)  # -> Segments, Vertices
construct_plane_2 = ConstructPlane(Origin=explode.Vertices, XAxis=line, YAxis=cross_product.Vector)
rotate_plane = RotatePlane(Plane=construct_plane_2, Angle="-0.5 * Pi")
flip_plane = FlipPlane(Plane=rotate_plane, ReverseX=False, ReverseY=False, SwapAxes=True)
predefined_spindle_end_effector = PredefinedSpindleEndEffector()
predefined_kuka_kr_125_2 = PredefinedKUKAKR1252(RobRootFrame=PlaneXY(0, 0, 0), EndEffectorOptional=predefined_spindle_end_effector)
interpolate_frames = InterpolateFrames(Frames=flip_plane, Length=Slider(0, range=0..1), Step="1", Reset=Toggle(True))  # -> Frame, Percent, CurrentIndex
robot_inverse_kinematics = RobotInverseKinematics(
    Robot=predefined_kuka_kr_125_2,
    TargetTCPFrame=interpolate_frames.Frame,
    AxisToggles=[False, False, False],
    useColorPreview=True)  # -> PoseGeometry, AxisValues

# ---- group: gcode
deconstruct_plane = DeconstructPlane(Plane=flip_plane)  # -> Origin, XAxis, YAxis, ZAxis
list_length_2 = ListLength(List=deconstruct_plane.Origin)
tool_no = Panel("1")
spindle_speed_rpm = Panel("14000")
feed_mm_min = Panel("2400")
repeat_data = RepeatData(Data="G1", Length=expr("x - 2", list_length_2))
nc_settings = NCSettings(Tool=tool_no, Speed=spindle_speed_rpm, Feed=feed_mm_min)
merge = Merge(Data1="G0", Data2=flatten(repeat_data), Data3="G0")
nc_generation = NCGeneration(Points=deconstruct_plane.Origin, Vectors=deconstruct_plane.ZAxis, Feed=merge, Settings=nc_settings)

# ----
panel = Panel(nc_generation)

# ==== cluster Cluster
curve = ClusterInput()
curve_2 = ClusterInput()
curve_3 = Curve(curve)
curve_4 = Curve(curve_2)
cross_product = CrossProduct(VectorA=curve_3, VectorB=curve_4, Unitize=False)  # -> Vector, Length
end_points = EndPoints(Curve=curve_3)  # -> Start, End
line_sdl = LineSDL(Start=end_points.Start, Direction=cross_product.Vector, Length=1)
plane_3pt = Plane3Pt()
line_line = LineLine(LineA=curve_3, LineB=line_sdl)
line_plane = LinePlane(Line=curve_4, Plane=line_line)  # -> Point, ParamL, ParamP
point = ClusterOutput(line_plane.Point)

# ==== cluster Cluster_2
curve = ClusterInput()
curve_2 = Curve(curve)
vector_a = ClusterInput()
A = ClusterInput()
B = ClusterInput()
angle = Angle(VectorA=vector_a, VectorB=curve_2)  # -> Angle, Reflex
maximum = Maximum(A=A, B=B)
multiplication = Multiplication(A=maximum, B="1.2/2")
sine = Sine(Value=angle.Angle)
division = Division(A=multiplication, B=sine)
vector = Vector(curve_2)
point = ClusterInput()
multiplication_2 = Multiplication(A=vector, B=division)
point_2 = Point(point)
move = Move(Geometry=point_2, Motion=expr("-x", multiplication_2))  # -> Geometry, Transform
move_2 = Move(Geometry=point_2, Motion=multiplication_2)  # -> Geometry, Transform
geometry = ClusterOutput(move_2.Geometry)
geometry_2 = ClusterOutput(move.Geometry)
