# Grasshopper definition fab_ts.gh (Grasshopper 1.0.7)
# plug-ins: Sandbox, Virtual Robot

# ---- group: scan distance (camera to bamboo A)
scan_distance_350mm_500mm = Panel("350")

# ---- group: bamboo A (to be cut) diameter
diameter_a = Panel("30")

# ---- group: Current State of Fabrication
# fabrication order
number_slider = Slider(6, range=0..8)

# ---- group: Read Data From Kuka Monitor
z = Panel("1070.68")
# scan bamboo A on turntable
x = Panel("143.645")
y = Panel("-2527.205")
x_2 = Panel("146.235")
y_2 = Panel("-2001.265")
z_2 = Panel("1070.68")

# ---- group: No.7
panel = Panel("""1
4""")
geometry = Geometry(<curve referenced from the Rhino model>)

# ---- group: No.8
panel_2 = Panel("""2
5""")
geometry_2 = Geometry(<curve referenced from the Rhino model>)

# ---- group: No.1
panel_3 = Panel("Null")
geometry_3 = Geometry(<curve referenced from the Rhino model>)

# ---- group: No.2
panel_4 = Panel("Null")
geometry_4 = Geometry(<curve referenced from the Rhino model>)

# ---- group: No.3
panel_5 = Panel("""0
1""")
geometry_5 = Geometry(<curve referenced from the Rhino model>)

# ---- group: No.5
panel_6 = Panel("""2
0""")
geometry_6 = Geometry(<curve referenced from the Rhino model>)

# ---- group: hand-eye calibration
# end to camera
# T(6->Camera)
matrix = Matrix({0;0=0.9559237072, 0;1=-0.2432103468, 0;2=0.1644949642, 0;3=0, 1;0=0.1644949642, 1;1=0.9076733712, 1;2=0.3860964361, 1;3=2.819077862, 2;0=-0.2432103468, 2;1=-0.3420201433, 2;2=0.9076733712, 2;3=24.97393957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})

# ---- group: No.6
panel_7 = Panel("""0
3""")
geometry_7 = Geometry(<curve referenced from the Rhino model>)

# ---- group: No.0
panel_8 = Panel("Null")
geometry_8 = Geometry(<curve referenced from the Rhino model>)

# ---- group: No.4
panel_9 = Panel("""1
2""")
geometry_9 = Geometry(<curve referenced from the Rhino model>)

# ----
construct_point = ConstructPoint(XCoordinate=x_2, YCoordinate=y_2, ZCoordinate=z_2)
construct_point_2 = ConstructPoint(XCoordinate=x, YCoordinate=y, ZCoordinate=z_2)
line = Line(StartPoint=construct_point_2, EndPoint=construct_point)
# bamboo A
curve = Curve(line)

# ---- group: desired scan point on bamboo
evaluate_curve = EvaluateCurve(Curve=reparameterize(curve), Parameter="0.8")  # -> Point, Tangent, Angle
unit_z = UnitZ(Factor=scan_distance_350mm_500mm)
move = Move(Geometry=evaluate_curve.Point, Motion=unit_z)  # -> Geometry, Transform

# ----
entwine = Entwine(
    Branch00=panel_8,
    Branch01=panel_3,
    Branch02=panel_4,
    Branch03=panel_5,
    Branch04=panel_9,
    Branch05=panel_6,
    Branch06=panel_7,
    Branch07=panel,
    Branch08=panel_2,
    FlattenInputs=True)  # -> simplify(Result)
merge = Merge(
    Data1=geometry_8,
    Data2=geometry_3,
    Data3=geometry_4,
    Data4=geometry_5,
    Data5=geometry_9,
    Data6=geometry_6,
    Data7=geometry_7,
    Data8=geometry,
    Data9=geometry_2)
pipe = Pipe(Curve=curve, Radius=expr("0.5 * x", diameter_a), Caps=1)
tree_branch = TreeBranch(Tree=entwine, Path=number_slider, MaintainPaths=True)
list_item = ListItem(List=merge, Index=number_slider, Wrap=False)
list_item_2 = ListItem(List=merge, Index=tree_branch, Wrap=False)
point = Point(move.Geometry)

# ---- group: scan curve
pi = Pi(Factor=expr("-x", "0.3"))
pi_2 = Pi(Factor="0.3")
point_2 = Point(point)
rotate_axis = RotateAxis(Geometry=point_2, Angle=pi, Axis=curve)  # -> Geometry, Transform
rotate_axis_2 = RotateAxis(Geometry=point_2, Angle=pi_2, Axis=curve)  # -> Geometry, Transform
arc_3pt = Arc3Pt(PointA=rotate_axis.Geometry, PointB=point_2, PointC=rotate_axis_2.Geometry)  # -> Arc, Plane, Radius

# ----
geometry_10 = Geometry(arc_3pt.Arc)

# ---- group: plane for moving path
curve_2 = Curve(geometry_10)
divide_curve = DivideCurve(Curve=reparameterize(curve_2), Count="100", Kinks=False)  # -> Points, Tangents, Parameters
evaluate_curve_2 = EvaluateCurve(Curve=reparameterize(curve_2), Parameter=divide_curve.Parameters)  # -> Point, Tangent, Angle
line_2 = Line(curve)
point_3 = Point(evaluate_curve_2.Point)
end_points = EndPoints(Curve=line_2)  # -> Start, End
vector_2pt = Vector2Pt(PointA=end_points.Start, PointB=end_points.End, Unitize=True)  # -> expr("-x", Vector), Length
cross_product = CrossProduct(VectorA=evaluate_curve_2.Tangent, VectorB=vector_2pt.Vector, Unitize=True)  # -> Vector, Length
vector_display_ex = VectorDisplayEx(Point=point_3, Vector=expr("x * 100", cross_product.Vector), Colour=ColourSwatch(SwatchColor=RGB(8, 135, 255)), Width=2)
vector_display_ex_2 = VectorDisplayEx(
    Point=point_3,
    Vector=expr("x*100", evaluate_curve_2.Tangent),
    Colour=ColourSwatch(SwatchColor=RGB(255, 120, 120)),
    Width=2)
vector_display_ex_3 = VectorDisplayEx(Point=point_3, Vector=expr("x * 100", vector_2pt.Vector), Colour=ColourSwatch(SwatchColor=RGB(99, 212, 120)), Width=2)
vector = Vector(cross_product.Vector)
vector_2 = Vector(evaluate_curve_2.Tangent)
vector_3 = Vector(vector_2pt.Vector)
point_4 = Point(divide_curve.Points)
construct_plane = ConstructPlane(Origin=point_4, XAxis=vector_2, YAxis=vector_3)  # -> simplify(graft(Plane))
rotate_plane = RotatePlane(Plane=construct_plane, Angle="-0.5 * Pi")  # -> simplify(Plane)

# ---- group: No. Mark Text
end_points_2 = EndPoints(Curve=merge)  # -> Start, End
panel_10 = Panel("""0
1
2
3
4
5
6
7
8""")
point_5 = Point(end_points_2.End)
text_tag_3d = TextTag3D(Location=point_5, Text=panel_10, Size="50", Colour=ColourSwatch(SwatchColor=RGB(0, 255, 213)), Justification=7)

# ---- group: bamboo to connect
pipe_2 = Pipe(Curve=list_item_2, Radius=" 15", Caps=1)
custom_preview = CustomPreview(Geometry=pipe_2, Material=ColourSwatch(SwatchColor=RGB(255, 255, 255)))

# ---- group: bamboo to mill
pipe_3 = Pipe(Curve=list_item, Radius=" 15", Caps=1)
custom_preview_2 = CustomPreview(Geometry=pipe_3, Material=ColourSwatch(SwatchColor=RGB(255, 166, 0)))

# ----
plane = Plane(rotate_plane)

# ---- group: robot simulation
invert_matrix = InvertMatrix(Matrix=matrix, Tolerance=0)  # -> Matrix, Success
plane2matrix = Plane2matrix(target=plane)
multiplication = Multiplication(A=plane2matrix, B=invert_matrix.Matrix)
pose2plane = Pose2plane(matrix=multiplication)  # -> flatten(plane)
predefined_kuka_kr_125_2 = PredefinedKUKAKR1252(RobRootFrame=PlaneXY(0, 0, 0))
interpolate_frames = InterpolateFrames(Frames=flatten(pose2plane), Length=Slider(0.204, range=0..1), Step="1", Reset=Toggle(True))  # -> Frame, Percent, CurrentIndex
robot_inverse_kinematics = RobotInverseKinematics(
    Robot=predefined_kuka_kr_125_2,
    TargetTCPFrame=interpolate_frames.Frame,
    AxisToggles=[False, False, False],
    useColorPreview=True)  # -> PoseGeometry, AxisValues

# ---- group: gcode
deconstruct_plane = DeconstructPlane(Plane=pose2plane)  # -> Origin, XAxis, YAxis, ZAxis
list_length = ListLength(List=deconstruct_plane.Origin)
repeat_data = RepeatData(Data="G1", Length=expr("x - 2", list_length))
nc_settings = NCSettings(Tool=1, Speed=1000, Feed=100)
merge_2 = Merge(Data1="G0", Data2=flatten(repeat_data), Data3="G0")
nc_generation = NCGeneration(Points=deconstruct_plane.Origin, Vectors=deconstruct_plane.ZAxis, Feed=merge_2, Settings=nc_settings)
split = SplitList(List=nc_generation, Index="6")  # -> ListA, ListB
merge_3 = Merge(Data1=flatten(split.ListA), Data2="TCPZROT / -90.0", Data3=flatten(split.ListB))

# ----
panel_11 = Panel(merge_3)

# ==== cluster Plane2matrix
xy_plane = XYPlane(Origin=Point(0, 0, 0))
target = ClusterInput()
orient = Orient(Source=xy_plane, Target=target)  # -> Geometry, Transform
matrix = Matrix(orient.Transform)
matrix_2 = ClusterOutput(matrix)

# ==== cluster Pose2plane
matrix = ClusterInput()
deconstruct_matrix = DeconstructMatrix(Matrix=matrix)  # -> Rows, Columns, Values
panel = Panel("""3
7
11""")
panel_2 = Panel("""0
4
8""")
panel_3 = Panel("""1
5
9""")
list_item = ListItem(List=deconstruct_matrix.Values, Index=panel, Wrap=True)
list_item_2 = ListItem(List=deconstruct_matrix.Values, Index=panel_2, Wrap=True)
list_item_3 = ListItem(List=deconstruct_matrix.Values, Index=panel_3, Wrap=True)
list_item_4 = ListItem(List=list_item, Index=0, Wrap=True)  # -> Item, Item1, Item2
list_item_5 = ListItem(List=list_item_2, Index=0, Wrap=True)  # -> Item, Item1, Item2
list_item_6 = ListItem(List=list_item_3, Index=0, Wrap=True)  # -> Item, Item1, Item2
construct_point = ConstructPoint(XCoordinate=list_item_4.Item, YCoordinate=list_item_4.Item1, ZCoordinate=list_item_4.Item2)
vector_xyz = VectorXYZ(XComponent=list_item_5.Item, YComponent=list_item_5.Item1, ZComponent=list_item_5.Item2)  # -> Vector, Length
vector_xyz_2 = VectorXYZ(XComponent=list_item_6.Item, YComponent=list_item_6.Item1, ZComponent=list_item_6.Item2)  # -> Vector, Length
construct_plane = ConstructPlane(Origin=construct_point, XAxis=vector_xyz.Vector, YAxis=vector_xyz_2.Vector)
plane = ClusterOutput(construct_plane)
